# Grasshopper definition ODD-Component.gh (Grasshopper 1.0.7)
# plug-ins: HiltonGHPlugin, Bifocals

# ODD component assembly
# Utility Component
panel = Panel("My Name is ")
series = Series(Start=0, Step=1, Count=10)
dom = ConstructDomain(DomainStart=0, DomainEnd=1)
pt = Point(Point(0, 0, 0))
# MAssAddition
jitter = Jitter(List=series, Jitter=1, Seed=2)  # -> Values, Indices
panel_2 = Panel(series)
strconcat = StringConcatenation(StringA=panel, StringB="Hilton Ma")  # -> Concat, Length
series_2 = Series(Start=Slider(9.72, range=0..10), Step=Slider(1.31, range=0..10), Count=Slider(10, range=0..10))
panel_3 = Panel(dom)
ptgrid = PointGrid(
    Start=pt,
    CountX=Slider(4, range=0..10),
    StepX=Slider(4.86, range=0..10),
    CountY=Slider(5, range=0..10),
    StepY=Slider(8.5, range=0..10))
range = Range(Domain=dom, Steps=Slider(10, range=0..10))
panel_4 = Panel(strconcat.Length)
panel_5 = Panel(strconcat.Concat)
massadd = MassAddition(Numbers=series)  # -> Result, Partial
panel_6 = Panel(series_2)
panel_7 = Panel(ptgrid)
panel_8 = Panel(range)
panel_9 = Panel(massadd.Partial)
panel_10 = Panel(massadd.Result)
# Vector Component
consvector = ConstructVector(X=Slider(10.5, range=0..100), Y=Slider(32.2, range=0..100), Z=Slider(10.5, range=0..100))  # -> Vector, Length
panel_11 = Panel(consvector.Vector)
panel_12 = Panel(consvector.Length)
# NURBS Component
crv = Curve(<curve referenced from the Rhino model>)
divcurve = DivideCurve(Curve=crv, Steps=Slider(15, range=0..100))  # -> Points, Parameters, Tangents
panel_13 = Panel(divcurve.Points)
panel_14 = Panel(divcurve.Parameters)
panel_15 = Panel(divcurve.Tangents)
number_slider = Slider(4.86, range=0..10)
number_slider_2 = Slider(5, range=0..10)
number_slider_3 = Slider(8.5, range=0..10)
number_slider_4 = Slider(2, range=0..10)
data = Data(ptgrid)
# DataTree
# Implements basic Grasshopper Data Tree functionality in an easy-to-use class. This class is used primarily in Scripting components. If you're using the Grasshopper SDK you should consider using the > class instead.
pt_2 = Point(Point(0, 0, 0))
remitem = RemoveItem(List=data, Index=Slider(2, range=0..10))
pointsdatatree = CSharpScript(S=pt_2, NX=number_slider_4, DX=number_slider, NY=number_slider_2, DY=number_slider_3)  # -> out, P; inputs S: Point3d, NX: Int32, DX: Double, NY: Int32, DY: Double
# ---------- pointsdatatree: C# ----------
    //Algo
    DataTree<Point3d> pts = new DataTree<Point3d>();
    for(int j = 0;j < NY;j++)
    {
      double y = S.Y + DY * j;
      GH_Path path = new GH_Path(j);
      for (int i = 0;i < NX;i++)
      {
        double x = S.X + DX * i;
        Point3d p = new Point3d(x, y, S.Z);

        pts.Add(p, path);
      }
    }

    //Outputs
    P = pts;
# ---------- end pointsdatatree ----------

# ----
# TreeInfo
data_2 = Data(pointsdatatree.P)
treeinfo = TreeInfo(Tree=data_2)  # -> Topology, Description, Paths, BranchCount, ItemCount
treeinfo_2 = CSharpScript(T=data_2)  # -> out, Topology, Description, Paths, BranchCount, ItemCount; inputs T: tree
# ---------- treeinfo_2: C# ----------
    //Algo
    List<string> desStr = new List<string>();
    for(int i = 0;i < T.BranchCount;i++)
    {
      List<Object> branch = T.Branches[i];
      GH_Path path=T.Paths[i];
      string str = "Path" + path.ToString() + " contains " + branch.Count + " elements ";
      desStr.Add(str);
    }
    
    //Output
    Topology = T.TopologyDescription;
    Description = desStr;
    Paths = T.Paths;
    BranchCount = T.BranchCount;
    ItemCount = T.DataCount;
# ---------- end treeinfo_2 ----------
panel_16 = Panel(treeinfo.Description)
panel_17 = Panel(treeinfo.Topology)
panel_18 = Panel(treeinfo.BranchCount)
panel_19 = Panel(treeinfo.ItemCount)
panel_20 = Panel(treeinfo_2.Topology)
panel_21 = Panel(treeinfo_2.out)
panel_22 = Panel(treeinfo_2.ItemCount)
panel_23 = Panel(treeinfo_2.Paths)
panel_24 = Panel(treeinfo_2.BranchCount)
panel_25 = Panel(treeinfo_2.Description)
panel_26 = Panel(treeinfo.Paths)

ptgrid_2 = PointGrid(Start=pt_2, CountX=number_slider_4, StepX=number_slider, CountY=number_slider_2, StepY=number_slider_3)
panel_27 = Panel(remitem)
panel_28 = Panel(pointsdatatree.out)
panel_29 = Panel(ptgrid_2)
panel_30 = Panel(pointsdatatree.P)
data_3 = Data(pointsdatatree.P)
treeinfo_3 = TreeInfo(Tree=data_3)  # -> Topology, Description, Paths, BranchCount, ItemCount
panel_31 = Panel(treeinfo_3.BranchCount)
panel_32 = Panel(treeinfo_3.Paths)
# L5.9
# Speeding Up Grasshopper Development  in VS control GH
# Reloadt the GH:
# 1.close the openning  GH file
# 2.RhinoCommand:GrasshopperReloadAssemblies
panel_33 = Panel(treeinfo_3.Topology)
panel_34 = Panel(treeinfo_3.ItemCount)
panel_35 = Panel(treeinfo_3.Description)

# ----
# L5.10
# Managing Persistent Data
# Privious lesson  GHC# -Trigger
number_slider_5 = Slider(7, range=0..10)
trigger = Trigger(Interval=100, TimerInterval=100, Target=c_script)  # disabled
c_script = CSharpScript(x=number_slider_5, R=Button())  # -> out, A, B, executions; inputs x: Double, R: Boolean
# ---------- c_script: C# ----------
    //Alg
    if (R)
    {
      iter = 0;
      val = 2;
    }
   
    iter++;
    
    val = val * 1.2;

    //Oput
    //A = x / 2;
    executions = iter;
    B = val;
# ---------- c_script: C# additional code ----------
  int iter = 0;
  double val = 2;
# ---------- end c_script ----------
panel_36 = Panel(c_script.B)
panel_37 = Panel(c_script.executions)

trigger_2 = Trigger(Interval=100, TimerInterval=100, Target=count)  # disabled
# Make a counter in VS
number_slider_6 = Slider(6, range=0..10)
count = Counter(Ticker=number_slider_6, Reset=Button())
panel_38 = Panel(count)
# L5.11
# Implementing Auto-Updates
number_slider_7 = Slider(6, range=0..10)
counterautoupdate = CounterAutoUpdate(Ticker=number_slider_7, Reset=Button(), AutoUpdates=Toggle(True), Interval=Slider(484, range=0..1000))
panel_39 = Panel(counterautoupdate)

# ----
# E.11
# Auto-Updating Dynamic Simulations
# previous less chain
number_slider_8 = Slider(9, range=0..100)
trigger_3 = Trigger(Interval=100, TimerInterval=100, Target=c_script_2)  # disabled
Z = UnitZ(Factor=Slider(-1, range=-1..2))
pt_3 = Point(<point referenced from the Rhino model>)
pt_4 = Point(<point referenced from the Rhino model>)
c_script_2 = CSharpScript(
    reset=Button(),
    anchor0=pt_3,
    anchor1=pt_4,
    nodeCount=number_slider_8,
    mass=Slider(0.06, range=0..1),
    gravity=Z,
    stiffness=Slider(0.01, range=0..1),
    friction=Slider(0.98, range=0..1))  # -> out, P, V, C; inputs reset: Boolean, anchor0: Point3d, anchor1: Point3d, nodeCount: Int32, mass: Double, gravity: Vector3d, stiffness: Double, friction: Double
# ---------- c_script_2: C# ----------
    //Alg
    //NurbsCurve lineCurve = new NurbsCurve();
    if (reset)
    {
      nodes.Clear();
      vels.Clear();

      Line line = new Line(anchor0, anchor1);
      NurbsCurve lineCurve = line.ToNurbsCurve();

      Point3d[] pts;
      lineCurve.DivideByCount(nodeCount - 1, true, out pts);
      nodes.AddRange(pts);

      for (int i = 0; i < nodeCount; i++)
      {
        vels.Add(Vector3d.Zero);
      }
    }
    //Update the location of the anchors
    nodes[0] = anchor0;
    nodes[nodes.Count - 1] = anchor1;

    //Simulate forces for each node
    for (int i = 1; i < nodes.Count - 1; i++)
    {
      Point3d n = nodes[i];
      Vector3d v = vels[i];

      //Calculating all the forces
      Vector3d gravityForce = mass * gravity;
      Vector3d prevSpring = -stiffness * (n - nodes[i - 1]);
      Vector3d nextSpring = -stiffness * (n - nodes[i + 1]);

      // Aggregate all forces
      Vector3d totalForces = gravityForce + prevSpring + nextSpring;

      //upate velocity
      v += totalForces;

      // Add friction
      v *= friction;

      //Update location of the node
      n += v;

      //Update values on the original lists
      nodes[i] = n;
      vels[i] = v;
      //lineCurve = new NurbsCurve(nodes);
    }

    //Out
    P = nodes;
    V = vels;
    C = new Polyline(nodes);
# ---------- c_script_2: C# additional code ----------
  List<Point3d> nodes = new List<Point3d>();
  List<Vector3d> vels = new List<Vector3d>();
# ---------- end c_script_2 ----------
vdis = VectorDisplay(Anchor=c_script_2.P, Vector=c_script_2.V)
geo = Geometry(c_script_2.P)
geo_2 = Geometry(c_script_2.C)
panel_40 = Panel(c_script_2.out)

trigger_4 = Trigger(Interval=100, TimerInterval=100, Target=elasticchain)  # disabled
pt_5 = Point(<point referenced from the Rhino model>)
Z_2 = UnitZ(Factor=Slider(-1.1, range=-10..2))
pt_6 = Point(<point referenced from the Rhino model>)
elasticchain = ElasticChain(
    Reset=Button(),
    AutoUpdate=Toggle(False),
    Interval=Slider(38, range=0..1000),
    Anchor0=pt_6,
    Anchor1=pt_5,
    NodeCount=Slider(9, range=0..100),
    Mass=Slider(0.06, range=0..1),
    Gravity=Z_2,
    Stiffness=Slider(0.011, range=0..1),
    Friction=Slider(0.98, range=0..1))  # -> Nodes, Velocity, Chain
geo_3 = Geometry(elasticchain.Chain)
panel_41 = Panel(elasticchain.Nodes)
panel_42 = Panel(elasticchain.Velocity)

# ----
# L5.12
# Native Custom Previews
pt_7 = Point(<point referenced from the Rhino model>)
vec = VectorXYZ(XComponent=Slider(10, range=10..100), YComponent=Slider(10, range=10..100), ZComponent=Slider(10, range=10..100))  # -> Vector, Length
c_script_3 = CSharpScript(A=pt_7, V=vec.Vector)  # -> out; inputs A: Point3d, V: Vector3d
# ---------- c_script_3: C# usings ----------
using Rhino.Display;
# ---------- c_script_3: C# ----------
    anchor = A;
    vector = V;
    arrow = new Line(A, V);
# ---------- c_script_3: C# additional code ----------
  Point3d anchor;
  Vector3d vector;
  Line arrow ;

  //Return a BoundingBox that contains all the geometry you  are about to draw.
  public override BoundingBox ClippingBox
  {
    get
    {
      return arrow.BoundingBox;
    }
  }
  public override void DrawViewportMeshes(IGH_PreviewArgs args)
  {

  }

  public override void DrawViewportWires(IGH_PreviewArgs args)
  {
    args.Display.DrawArrow(arrow, System.Drawing.Color.Coral);
  }
# ---------- end c_script_3 ----------

# ---- group: L4.11 - Custom vector rendering
pt_8 = Point(pt_7)
vec_2 = VectorXYZ(
    XComponent=Slider(-23.6, range=-632..70),
    YComponent=Slider(56.53, range=0..80),
    ZComponent=Slider(72.4, range=-190..130))  # -> Vector, Length
c_script_4 = CSharpScript(anchor=pt_8, vector=vec_2.Vector)  # -> out; inputs anchor: Point3d, vector: Vector3d
# ---------- c_script_4: C# ----------
    arrow = new Line(anchor, vector);
# ---------- c_script_4: C# additional code ----------
  Line arrow;

  //Return a BoundingBox that contains all the geometry you  are about to draw.
  public override BoundingBox ClippingBox
  {
    get
    {
      return arrow.BoundingBox;
    }
  }
  public override void DrawViewportMeshes(IGH_PreviewArgs args)
  {


  }

  public override void DrawViewportWires(IGH_PreviewArgs args)
  {
    args.Display.DrawArrow(arrow, System.Drawing.Color.Coral);
    double len = arrow.Length;
    Point2d textLocation = new Point2d(30, RhinoDocument.Views.ActiveView.Bounds.Height - 30);
    args.Display.Draw2dText(
      "Vector length:" + len.ToString(),
      System.Drawing.Color.Black,
      textLocation,
      false);
  }
# ---------- end c_script_4 ----------
line = LineSDL(Start=pt_8, Direction=vec_2.Vector, Length=vec_2.Length)
vdis_2 = VectorDisplay(Anchor=pt_8, Vector=vec_2.Vector)
panel_43 = Panel(c_script_4)

# ----
vecprev = VectorPreview(Anchor=pt_7, Vector=vec_2.Vector)
# L5.13
# Version Management
version = PluginVersion()
panel_44 = Panel(version)
version_2 = PluginVersion()  # -> Version, Major, Minor, Patch
# L5.14
# updates and  discard the code
version_3 = PluginVersion()
panel_45 = Panel(version_3)
panel_46 = Panel([version_2.Version, version_2.Major, version_2.Minor, version_2.Patch])
# L5.15
# How to Load Third-Party Libraries in your Plugin
mesh = Mesh(<mesh referenced from the Rhino model>)
m2dm3 = MeshToDMesh3(Mesh=mesh)
panel_47 = Panel(m2dm3)
# L5.16
# How to Implement your Own Console Using Static Data
toggle = BooleanToggle(False)
pt_9 = Point(<point referenced from the Rhino model>)
pt_10 = Point(<point referenced from the Rhino model>)
Z_3 = UnitZ(Factor=Slider(-1.1, range=-10..2))
oddconsolelogger = ODDConsoleLogger(Update=toggle, Clear=Button())
elasticchain_2 = ElasticChain(
    Reset=Button(),
    AutoUpdate=Toggle(False),
    Interval=Slider(38, range=0..1000),
    Anchor0=pt_10,
    Anchor1=pt_9,
    NodeCount=Slider(12, range=0..100),
    Mass=Slider(0.06, range=0..1),
    Gravity=Z_3,
    Stiffness=Slider(0.011, range=0..1),
    Friction=Slider(0.98, range=0..1))  # -> Nodes, Velocity, Chain
# L5.18
# publish  plugin on food4Rhino
panel_48 = Panel(oddconsolelogger)
geo_4 = Geometry(elasticchain_2.Chain)
panel_49 = Panel(elasticchain_2.Nodes)
panel_50 = Panel(elasticchain_2.Velocity)
